# Grasshopper definition assignment-01.gh (Grasshopper 1.0.8)

bc = Slider(12, range=1..18)
l = Slider(400, range=240..600)
h = Slider(16, range=14..20)

# ---- group: Auto-reloads cdf module on VScode changes
# Setting path for Src AutoReloader: 1. Right click on Path
# 2. Choose "Select a directory"
# 3. Locate the ..\cdf1_teaching\src folder in your computer
# Assignment-01: Bauhaus
path = FilePath("/Users/tillmirkes/workspace/cdf1_teaching/src/")
autoreloader = Python3Script(src_path=path)  # -> out; inputs src_path: String
# ---------- autoreloader: Python ----------
#! python3
import sys, os, time
import scriptcontext as sc
import Rhino, System
from System.IO import FileSystemWatcher, NotifyFilters

VERSION = 1  
pkg = "cdf"

if not src_path:
    raise Exception("Connect a folder to src_path.")
path = os.path.normpath(src_path)
watch_dir = os.path.join(path, pkg)
if not os.path.isdir(watch_dir):
    raise Exception("No '{}' folder found in:\n{}".format(pkg, path))

def unload():
    for name in list(sys.modules):
        if name == pkg or name.startswith(pkg + "."):
            del sys.modules[name]

# Put this folder first in Python's search list
if path in sys.path:
    sys.path.remove(path)
sys.path.insert(0, path)

key = "cdf_watcher_" + str(ghenv.Component.InstanceGuid)
time_key = key + "_time"
version_key = key + "_version"

def stamp():
    sc.sticky[time_key] = time.strftime("%Y-%m-%d %H:%M:%S")

# Replace the old watcher if the folder changed or the script was updated
old = sc.sticky.get(key)
if old is not None and (os.path.normpath(old.Path) != watch_dir
                        or sc.sticky.get(version_key) != VERSION):
    old.Dispose()
    del sc.sticky[key]
    unload()

if key not in sc.sticky:
    comp = ghenv.Component
    last = [0.0]

    def reload_and_rerun():
        unload()
        stamp()
        doc = comp.OnPingDocument()
        if doc is None:            # reloader was deleted or the file closed
            return
        for obj in doc.Objects:
            if "Python" in obj.GetType().Name:
                obj.ExpireSolution(False)   # mark as out of date
        doc.NewSolution(False)              # recompute once

    def on_change(sender, e):
        if not e.FullPath.endswith(".py") or "__pycache__" in e.FullPath:
            return
        if time.time() - last[0] < 0.5:     # ignore the second event of a double save
            return
        last[0] = time.time()
        Rhino.RhinoApp.InvokeOnUiThread(System.Action(reload_and_rerun))

    w = FileSystemWatcher(watch_dir, "*.py")
    w.IncludeSubdirectories = True
    w.NotifyFilter = NotifyFilters.LastWrite
    w.Changed += on_change
    w.EnableRaisingEvents = True
    sc.sticky[key] = w
    sc.sticky[version_key] = VERSION
    stamp()                                  # time the watcher started

msg = "Last reloaded: {}\nWatching: {}".format(sc.sticky.get(time_key, "unknown"), watch_dir)
print(msg)
out = msg
# ---------- end autoreloader ----------
# NOTES:
# 
# - Use Python 3 Script blocks for your functions.
# - Import your functions and classes as: from cdf import my_function, My_class
# - Don't forget to add and name your INPUT and OUTPUT parameters that match your functions correctly. If you zoom in to the Python component you will see the + sign to add and - to remove them.
# - You need to attach the accurate components to your INPUT parameters: sliders for integers or floats, toggles or buttons for booleans, text for strings, Rhino geometries etc. etc.
# - If an INPUT is  a list, you need to right-click the parameter to set it as LIST access. Sometimes you need to also set the type of the INPUT by clicking TYPE HINT and selecting the correct input type.
# - If you want to hide an object, right-click component and uncheck Preview. To visualize again, check Preview.
# - If you get errors, READ THEM! They often tell what's wrong in a simple language. If not, copy-paste to CoPilot and don't be afraid to play around!
# 
# For more Grasshopper Help, go to:
# https://developer.rhino3d.com/guides/scripting/scripting-component/#script-inputs-and-outputs
panel = Panel(autoreloader)

# ----
pt = Point(Point(5.681958636, 2.403715724, 0))
pipe_diameter = Slider(12, range=1..100)
staircase = Python3Script(pt=pt, l=l, h=h, bc=bc)  # -> out, my_staircase_boxes; inputs pt: Point3d
# ---------- staircase: Python ----------
from cdf import create_staircase_boxes

my_staircase_boxes = create_staircase_boxes(
    box_count=bc,
    length=l,
    height=h,
    origin=pt
)
# ---------- end staircase ----------
cone_diameter = Slider(20, range=1..100)
bar_count = Slider(3, range=1..30)
cones = Python3Script(pt=pt, l=l, h=h, bc=bc, cone_diameter=cone_diameter)  # -> out, my_cones; inputs pt: Point3d
# ---------- cones: Python ----------
from cdf import create_staircase_cones

my_cones = create_staircase_cones(
    box_count=bc,
    length=l,
    height=h,
    origin=pt,
  cone_diameter=cone_diameter
)
# ---------- end cones ----------
pipes = Python3Script(pt=pt, l=l, h=h, bc=bc, pipe_diameter=pipe_diameter)  # -> out, my_pipes; inputs pt: Point3d
# ---------- pipes: Python ----------
from cdf import create_staircase_pipes

my_pipes = create_staircase_pipes(
   box_count=bc,
    length=l,
    height=h,
    origin=pt,
    pipe_diameter=pipe_diameter
)
# ---------- end pipes ----------

# ---- group: Visualize
preview = CustomPreview(Geometry=staircase.my_staircase_boxes, Material=ColourSwatch(SwatchColor=RGB(240, 237, 228)))

# ----
bars = Python3Script(pt=pt, l=l, h=h, bc=bc, bar_count=bar_count)  # -> out, my_bars; inputs pt: Point3d
# ---------- bars: Python ----------
from cdf import create_staircase_bars

my_bars = create_staircase_bars(
    box_count=bc,
    bar_count=bar_count,
    length=l,
    height=h,
    origin=pt
)
# ---------- end bars ----------

# ---- group: Visualize
preview_2 = CustomPreview(Geometry=pipes.my_pipes, Material=ColourSwatch(SwatchColor=RGB(33, 64, 154)))

preview_3 = CustomPreview(Geometry=bars.my_bars, Material=ColourSwatch(SwatchColor=RGB(190, 30, 45)))

preview_4 = CustomPreview(Geometry=cones.my_cones, Material=ColourSwatch(SwatchColor=RGB(245, 196, 0)))
